# Grasshopper definition thermopixel_ui.gh (Grasshopper 1.0.7)
# plug-ins: Pufferfish, Human UI, MetaHopper, Human

create_label = CreateLabel(LabelText="Distance between ThermoPixels (mm)", LabelSize=Slider(14, range=12..20), Justification=0)
create_slider = CreateSlider(Slider=Slider(8, range=8..20), ShowBounds=False, ShowTicks=False, ShowTooltip=False, ShowValLabel=True, showLabel=False)

create_label_2 = CreateLabel(LabelText="Number of ThermoPixels in X axis", LabelSize=Slider(14, range=1..20), Justification=0)
create_slider_2 = CreateSlider(Slider=Slider(3, range=1..20), ShowBounds=False, ShowTicks=False, ShowTooltip=False, ShowValLabel=True, showLabel=False)

data = Data(Slider(450, range=0..3000))
launch_window = LaunchWindow(
    Show=Toggle(True),
    Name="ThermoPixel Generator",
    Width=data,
    Height=Slider(1000, range=0..1500),
    ChildStatus=1,
    EnableHorizScroll=False)

file_path = FilePath("C:\Users\justin\Dropbox\My PC (DESKTOP-O1MDCKQ)\Documents\MAKE\Research\2023\ThermoPixels\figures\Artboard 1_3@4x.png")
file_path_2 = FilePath("C:\Users\justin\Dropbox\My PC (DESKTOP-O1MDCKQ)\Documents\MAKE\Research\2023\ThermoPixels\figures\Artboard 1_4@4x.png")
create_rhino_pick_button = CreateRhinoPickButton(ImagePath=file_path, Prompt="select a pcb layout", AllowMultiple=True, AllowNone=True, Type=2, ButtonStyle=0)
create_rhino_pick_button_2 = CreateRhinoPickButton(ImagePath=file_path_2, Prompt="select the first heater pads", AllowMultiple=True, AllowNone=True, Type=2, ButtonStyle=0)
adjust_element_positioning = AdjustElementPositioning(
    ElementsToAdjust=[create_rhino_pick_button, create_rhino_pick_button_2],
    AbsolutePositioning=False,
    Width=Slider(207, range=0..1000),
    HorizontalAlignment=1)
create_stack = CreateStack(UIElements=[create_rhino_pick_button, create_rhino_pick_button_2], Horizontal=True)

set_window_properties = SetWindowProperties(Window=launch_window, ShowTitleBar=True, BackgroundColor=ColourSwatch(SwatchColor=RGB(255, 255, 255)), ScaleFactor=1)

create_label_3 = CreateLabel(LabelText="Number of ThermoPixels in Y axis", LabelSize=Slider(14, range=12..20), Justification=0)
create_slider_3 = CreateSlider(Slider=Slider(3, range=1..10), ShowBounds=False, ShowTicks=False, ShowTooltip=False, ShowValLabel=True, showLabel=True)

create_label_4 = CreateLabel(LabelText="Color-changing layer thickness (mm)", LabelSize=Slider(14, range=12..20), Justification=0)
create_slider_4 = CreateSlider(Slider=Slider(1, range=0..10), ShowBounds=False, ShowTicks=False, ShowTooltip=False, ShowValLabel=True, showLabel=True)

create_markdown_viewer = CreateMarkdownViewer()

panel = Panel("""0.2
0.4
0.6
0.8
1.0
1.2
1.6
2.0
2.4
3.2""")
create_pulldown_menu = CreatePulldownMenu(Label="PCB thickness (mm)", ListItems=panel, showLabel=True)
adjust_element_positioning_2 = AdjustElementPositioning(
    ElementsToAdjust=create_pulldown_menu,
    AbsolutePositioning=False,
    Width=Slider(425, range=0..1000),
    HorizontalAlignment=1)

# ----
# bake geometry
file_path_3 = FilePath("C:\Users\justin\Dropbox\My PC (DESKTOP-O1MDCKQ)\Documents\MAKE\Research\2023\ThermoPixels\figures\Artboard 1_2@4x.png")
create_button = CreateButton(ImagePath=file_path_3, ButtonStyle=0)

create_text_block = CreateTextBlock(Text=" ", TextSize=Slider(14, range=0..20), Justification=0)
adjust_element_positioning_3 = AdjustElementPositioning(ElementsToAdjust=create_text_block, AbsolutePositioning=False, Width=Slider(407, range=0..1000), HorizontalAlignment=1)

create_label_5 = CreateLabel(LabelText="Adjust position (X, mm)", LabelSize=Slider(12, range=12..20), Justification=0)
create_slider_5 = CreateSlider(Slider=Slider(10, range=0..100), ShowBounds=False, ShowTicks=False, ShowTooltip=False, ShowValLabel=True, showLabel=True)

create_slider_6 = CreateSlider(Slider=Slider(2, range=-5..15), ShowBounds=False, ShowTicks=False, ShowTooltip=False, ShowValLabel=True, showLabel=True)
create_label_6 = CreateLabel(LabelText="Adjust position (Z, mm) ", LabelSize=Slider(14, range=12..20), Justification=0)

create_label_7 = CreateLabel(LabelText="Adjust position (Y, mm)", LabelSize=Slider(12, range=12..20), Justification=0)
create_slider_7 = CreateSlider(Slider=Slider(0, range=-20..20), ShowBounds=False, ShowTicks=False, ShowTooltip=False, ShowValLabel=True, showLabel=True)

# ----
# update settings
file_path_4 = FilePath("C:\Users\justin\Dropbox\My PC (DESKTOP-O1MDCKQ)\Documents\MAKE\Research\2023\ThermoPixels\figures\Artboard 1_1@44x.png")
create_button_2 = CreateButton(ImagePath=file_path_4, ButtonStyle=0)

file_path_5 = FilePath("C:\Users\justin\Dropbox\My PC (DESKTOP-O1MDCKQ)\Documents\MAKE\Research\2023\ThermoPixels\figures\Artboard 1@4x.png")
create_rhino_pick_button_3 = CreateRhinoPickButton(
    ImagePath=file_path_5,
    Prompt="select a brep to generate ThermoPixel",
    AllowMultiple=False,
    AllowNone=True,
    Type=1,
    ButtonStyle=0)
adjust_element_appearance = AdjustElementAppearance(
    ElementsToAdjust=[create_button_2, create_rhino_pick_button_3, create_button, create_rhino_pick_button, create_rhino_pick_button_2],
    Background=ColourSwatch(SwatchColor=RGB(255, 255, 255)))

all_ui = Merge(
    Data2=create_rhino_pick_button_3,
    Data3=create_button_2,
    Data4=create_label,
    Data5=create_slider,
    Data6=create_label_2,
    Data7=create_slider_2,
    Data8=create_label_3,
    Data9=create_slider_3,
    Data10=create_label_4,
    Data11=create_slider_4,
    Data14=create_label_5,
    Data15=create_slider_5,
    Data16=create_label_7,
    Data17=create_slider_7,
    Data18=create_label_6,
    Data19=create_slider_6,
    Data20=create_stack,
    Data21=create_pulldown_menu,
    Data22=create_text_block,
    Data23=create_button)
add_elements = AddElements(Window=launch_window, Elements=flatten(all_ui), DoVLChecking=True)  # -> AddedElements, ElementNames

# ----
# brep object
value_listener = ValueListener(Elements=create_rhino_pick_button_3, SomeProperty=True)  # -> Values, Indices

brep = Brep(value_listener.Values)

# ----
# brep => mesh => brep
settings_custom = SettingsCustom(
    StitchSeams=False,
    SimplePlanes=False,
    Refine=True,
    MinCount=1,
    MaxCount=400,
    AspectRatio=20,
    MaxDistance=0,
    MaxAngle=Slider(5, range=0..100),
    MinEdge=0,
    MaxEdge=Slider(10, range=0..100))
mesh_brep = MeshBrep(Brep=brep, Settings=settings_custom)
mesh_to_polysurface = MeshToPolysurface(Mesh=mesh_brep, Triangles=False, FaceMerge=False)
deconstruct_mesh = DeconstructMesh(Mesh=mesh_brep)  # -> Vertices, Faces, Colours, Normals

brep_2 = Brep(mesh_to_polysurface)

# ----
# get normal vector of target surface
number_slider = Slider(39, range=0..100)
divide_surface = DivideSurface(Surface=brep, UCount=Slider(61, range=0..100), VCount=number_slider)  # -> flatten(Points), flatten(Normals), Parameters
normal_vector_ref_points = Data(divide_surface.Points)
pt_normal = Data(divide_surface.Normals)

# ----
# if not polysurface_use this
deconstruct_brep = DeconstructBrep(Brep=brep_2)  # -> Faces, Edges, Vertices
evaluate_surface = EvaluateSurface(Surface=flatten(deconstruct_brep.Faces), Point=flatten(normal_vector_ref_points))  # -> Point, Normal, UDirection, VDirection, Frame

# ----
# update settings
value_listener_2 = ValueListener(Elements=create_button_2, SomeProperty=True)  # -> Values, Indices

# ----
# number of TP in Y
value_listener_3 = ValueListener(Elements=create_slider_3, NameFilterS=value_listener_2.Indices, SomeProperty=False)  # -> Values, Indices

# ----
# thermochromic thickness
value_listener_4 = ValueListener(Elements=create_slider_4, NameFilterS=value_listener_2.Indices, SomeProperty=False)  # -> Values, Indices

# ----
# adjust Z
value_listener_5 = ValueListener(Elements=create_slider_6, NameFilterS=value_listener_2.Indices, SomeProperty=False)  # -> Values, Indices

# ----
# adjust Y
value_listener_6 = ValueListener(Elements=create_slider_7, NameFilterS=value_listener_2.Indices, SomeProperty=False)  # -> Values, Indices

# ----
# number of TP in X
value_listener_7 = ValueListener(Elements=create_slider_2, NameFilterS=value_listener_2.Indices, SomeProperty=False)  # -> Values, Indices

# ----
# adjust X
value_listener_8 = ValueListener(Elements=create_slider_5, NameFilterS=value_listener_2.Indices, SomeProperty=False)  # -> Values, Indices

# ----
# distance between TP
value_listener_9 = ValueListener(Elements=create_slider, NameFilterS=value_listener_2.Indices, SomeProperty=False)  # -> Values, Indices

# ----
# pcb layout
value_listener_10 = ValueListener(Elements=create_rhino_pick_button, SomeProperty=True)  # -> Values, Indices

# ----
# bake object
value_listener_11 = ValueListener(Elements=create_button, SomeProperty=True)  # -> Values, Indices

# ----
# initial footprint
value_listener_12 = ValueListener(Elements=create_rhino_pick_button_2, SomeProperty=True)  # -> Values, Indices

# ----
# pcb thickness
value_listener_13 = ValueListener(Elements=create_pulldown_menu, NameFilterS=value_listener_2.Indices, SomeProperty=False)  # -> Values, Indices

thermochromic_thickness = Slider(2, range=0..10)
starting_point = Slider(5, range=0..20)
d_between_xy = Slider(10, range=10..20)
x_count = Slider(4, range=1..10)
adjust_z = Slider(-1, range=-20..10)
y_count = Slider(3, range=1..10)

panel_2 = Panel(value_listener_2.Values)
distance_between_footage = Number(value_listener_9.Values)
adjust_y = Number(value_listener_6.Values)
thermo_thickness = Number(value_listener_4.Values)
adjust_z_2 = Number(value_listener_5.Values)
data_2 = Data(adjust_z_2)
multiplication = Multiplication(A=data_2, B=-1)

# ----
# adjust footprint plane Z poisition
addition = Addition(A=multiplication, B=Slider(1, range=0..1))
cluster = Cluster(content=brep_2, distance_from_base=addition)

# ----
# footprint surface base region
project = Project(Geometry=brep_2, Plane=cluster)  # -> Geometry, Transform

boundary_surfaces = BoundarySurfaces(Edges=project.Geometry)

# ----
# boundry-region
# for heater footage
number_slider_2 = Slider(0, range=0..10)
offset_curve = OffsetCurve(Curve=boundary_surfaces, Distance=expr("-x", number_slider_2), Corners=1)

region_curve = Data(offset_curve)

# ----
# project nomal
# vector points
area = Area(Geometry=region_curve)  # -> Area, Centroid
xy_plane = XYPlane(Origin=area.Centroid)
project_2 = Project(Geometry=flatten(normal_vector_ref_points), Plane=xy_plane)  # -> Geometry, Transform

adjust_x = Number(value_listener_8.Values)
y_count_2 = Number(value_listener_3.Values)
x_count_2 = Number(value_listener_7.Values)
pcb_thickness = Number(value_listener_13.Values)
first_heater = Curve(value_listener_12.Values)
pcb = Curve(value_listener_10.Values)
createattributes = CreateAttributes(LayerName="color-change", Color=ColourSwatch(SwatchColor=RGB(255, 0, 123)), enableFullPath=True)
createattributes_2 = CreateAttributes(LayerName="heater", Color=ColourSwatch(SwatchColor=RGB(110, 110, 110)), enableFullPath=True)
createattributes_3 = CreateAttributes(LayerName="handcrank", enableFullPath=True)

# ----
# generate a solid brep from a ref plane
initial_surface_copy = Data(brep)
deconstruct_brep_2 = DeconstructBrep(Brep=initial_surface_copy)  # -> Faces, Edges, Vertices
list_item = ListItem(List=deconstruct_brep_2.Edges, Index=1, Wrap=True)
list_item_2 = ListItem(List=deconstruct_brep_2.Edges, Index=0, Wrap=True)
flip_curve = FlipCurve(Curve=list_item)  # -> Curve, Flag
loft = Loft(
    Curves=[list_item_2, flip_curve.Curve],
    Options={Adjust=False, Closed=False, LoftEnds=0, LoftSimp=0, LoftType=0, Rebuild=10, Refit=0.01})
brep_join = BrepJoin(Breps=flatten([initial_surface_copy, loft]))  # -> Breps, Closed
cap_holes = CapHoles(Brep=brep_join.Breps)

panel_3 = Panel("""0
2""")
number_slider_3 = Slider(0.2, range=0..1)
colour_swatch = ColourSwatch(SwatchColor=RGBA(93, 0, 255, 37))

# ----
# initial ref point
explode = Explode(Curve=region_curve, Recursive=True)  # -> Segments, Vertices
unit_x = UnitX(Factor=expr("-x", "4"))

# ----
# finding the longest curve
length = Length(Curve=flatten(explode.Segments))
list_length = ListLength(List=length)
series = Series(Start=0, Step=1, Count=list_length)  # -> flatten(Series)
sort_list = SortList(Keys=length, ValuesA=series)  # -> Keys, ValuesA

list_item_3 = ListItem(List=sort_list.ValuesA, Index=0, Wrap=True)
list_item_4 = ListItem(List=sort_list.ValuesA, Index=1, Wrap=True)

list_item_5 = ListItem(List=explode.Segments, Index=list_item_3, Wrap=True)
list_item_6 = ListItem(List=explode.Segments, Index=list_item_4, Wrap=True)
curve_middle = CurveMiddle(Curve=list_item_5)
curve_middle_2 = CurveMiddle(Curve=list_item_6)
line = Line(StartPoint=curve_middle, EndPoint=curve_middle_2)

# ----
# modify starting point
divide_length = DivideLength(Curve=line, Length=1)  # -> Points, Tangents, Parameters
list_item_7 = ListItem(List=divide_length.Points, Index=adjust_x, Wrap=True)

move = Move(Geometry=list_item_7, Motion=unit_x)  # -> Geometry, Transform

# ----
# initial point
interval_point = Subtraction(A=y_count_2, B=1)
full_length_y = Multiplication(A=distance_between_footage, B=interval_point)
unit_y = UnitY(Factor=expr("-x/2", full_length_y))
move_2 = Move(Geometry=move.Geometry, Motion=unit_y)  # -> Geometry, Transform

# ----
# move initial point in Y direction
number_slider_4 = Slider(10, range=-10..10)
unit_y_2 = UnitY(Factor=adjust_y)
move_3 = Move(Geometry=move_2.Geometry, Motion=unit_y_2)  # -> Geometry, Transform

data_3 = Data(move_3.Geometry)

# ----
# x axis count
series_2 = Series(Start=0, Step=expr("-x", distance_between_footage), Count=x_count_2)
unit_x_2 = UnitX(Factor=series_2)
move_4 = Move(Geometry=data_3, Motion=unit_x_2)  # -> Geometry, Transform

# ----
# y axis count
series_3 = Series(Start=0, Step=distance_between_footage, Count=y_count_2)
unit_y_3 = UnitY(Factor=series_3)
move_5 = Move(Geometry=graft(move_4.Geometry), Motion=unit_y_3)  # -> flatten(Geometry), Transform

point_in_curve = PointInCurve(Point=move_5.Geometry, Curve=region_curve)  # -> Relationship, Point
check_points_in_boundary = CSharpScript(relationship=point_in_curve.Relationship, points=point_in_curve.Point)  # -> out, A, flatten(B); inputs relationship: list of Int32, points: list of Point3d
# ---------- check_points_in_boundary: C# ----------
    string msg;

    for( int i = 0 ; i < relationship.Count; i++)
    {
      if(relationship[i] != 2)
      {
        msg = "\nHeaters are OUT of the SURFACE REGION!! \nPlease adjust heater number or distance between them";
        B = msg;
        break;
      }
      else
      {
        msg = "\nYou are good to go :) Bake ThermoPixels when you are ready!";
      }


      if( i == relationship.Count - 1)
      {

        A = points;
        B = msg;
      }
    }
# ---------- end check_points_in_boundary ----------
check_inbound = Data(check_points_in_boundary.B)
panel_4 = Panel(check_inbound)
set_textblock_contents = SetTextBlockContents(TextBlockToModify=create_text_block, NewTextBlockContents=panel_4)
base_footage_position = Data(flatten(check_points_in_boundary.A))

# ----
# heater footprint
panel_5 = Panel("-3 to 3")
rectangle = Rectangle(Plane=base_footage_position, XSize=panel_5, YSize=panel_5, Radius=0)  # -> flatten(Rectangle), Length
null_item = NullItem(Item=rectangle.Rectangle)  # -> NullFlags, InvalidFlags, Description
cull_pattern = CullPattern(List=rectangle.Rectangle, CullPattern=invert(null_item.NullFlags))

# ----
# get points' index value
# that are inside the footprint region
getindicesinsidecrv = CSharpScript(point=flatten(project_2.Geometry), footprint=flatten(cull_pattern), footprint_plane=xy_plane)  # -> out, list_out; inputs point: list of Point3d, footprint: list of Curve, footprint_plane: Plane
# ---------- getindicesinsidecrv: C# ----------
    DataTree<int> index_list = new DataTree<int>();

    // check point region
    for(int i = 0; i < footprint.Count; i++) // for every footprint
    {
      GH_Path dt_branch = new GH_Path(i);

      for(int j = 0; j < point.Count; j++) // for every points
      {
        //return value 1 is inside 2 is outside
        int curve_pt_relation = (int) footprint[i].Contains(point[j], footprint_plane, RhinoDocument.ModelAbsoluteTolerance);
        if(curve_pt_relation == 1)
        {
          index_list.Add(j, dt_branch);
        }
      }
    }

    list_out = index_list;
# ---------- end getindicesinsidecrv ----------

# ----
# points inside footprint
list_item_8 = ListItem(List=normal_vector_ref_points, Index=getindicesinsidecrv.list_out, Wrap=True)  # -> simplify(Item)

# ----
# get center point of srf segment
project_3 = Project(Curve=cull_pattern, Brep=brep_2, Direction=Vector(0, 0, 1))
bounding_box = BoundingBox(Content=project_3, Plane=PlaneXY(0, 0, 0))  # -> Box, Box_2
area_2 = Area(Geometry=bounding_box.Box)  # -> Area, Centroid

# ----
# vector inside footprint
list_item_9 = ListItem(List=pt_normal, Index=getindicesinsidecrv.list_out, Wrap=True)  # -> simplify(Item)

list_item_10 = ListItem(List=flatten(area_2.Centroid), Index=0, Wrap=True)

# ----
# average normal vector
average = Average(Input=list_item_9)  # -> flatten(ArithmeticMean)

unit_vector = UnitVector(Vector=average)
panel_6 = Panel(unit_vector)
to_polar = ToPolar(Point=unit_vector, System=PlaneXY(0, 0, 0))  # -> Phi, Theta, Radius

# ----
# plane_for_crvSrf
plane_normal = PlaneNormal(Origin=flatten(area_2.Centroid), ZAxis=flatten(average))

# ----
# flat plane
adjust_plane = AdjustPlane(Plane=plane_normal, Normal=Vector(0, 0, 1))

degrees = Degrees(Radians=to_polar.Theta)
degrees_2 = Degrees(Radians=to_polar.Phi)

# ----
# visualize vector
vector_display = VectorDisplay(Anchor=flatten(area_2.Centroid), Vector=average)
vector_display_2 = VectorDisplay(Anchor=list_item_8, Vector=list_item_9)

panel_7 = Panel(adjust_plane)

# ----
# calculate plane angle
deconstruct_plane = DeconstructPlane(Plane=plane_normal)  # -> Origin, XAxis, YAxis, ZAxis
deconstruct_plane_2 = DeconstructPlane(Plane=adjust_plane)  # -> Origin, XAxis, YAxis, ZAxis
yz_plane = YZPlane(Origin=Point(0, 0, 0))
angle = Angle(VectorA=deconstruct_plane_2.XAxis, VectorB=deconstruct_plane.XAxis, Plane=yz_plane)  # -> Angle, Reflex
degrees_3 = Degrees(Radians=angle.Angle)

panel_8 = Panel(degrees)
panel_9 = Panel(degrees_2)

# ----
# create_rotation_axis
area_3 = Area(Geometry=adjust_plane)  # -> Area, Centroid
unit_x_3 = UnitX(Factor=1)
move_6 = Move(Geometry=area_3.Centroid, Motion=unit_x_3)  # -> Geometry, Transform
rot_axis = Line(StartPoint=area_3.Centroid, EndPoint=move_6.Geometry)

# ----
# from the rounded angle value,
# we rotate flat plane to fit
# its curved surface
round_angle = CSharpScript(num=degrees_3)  # -> out, angle, type; inputs num: list of Double
# ---------- round_angle: C# ----------
    List<int> deg = new List<int>();
    List<int> heater_type = new List<int>(); // 0 flat, 1 mild, 2 steep
    int angle_threshold = 50;
    for(int i = 0 ; i < num.Count;i++)
    {
      if(num[i] < 10)
      {
        deg.Add(0);
        heater_type.Add(0); // flat
      }
      else
      {
        int roundedVal = (int) Math.Round(num[i], 1);
        deg.Add(roundedVal);

        if(roundedVal >= 180)
        {
          roundedVal = 360 - roundedVal;
        }

        if(roundedVal >= angle_threshold) heater_type.Add(2); // steep type
        else heater_type.Add(1); // mild angle type

      }

    }

    angle = deg;
    type = heater_type;
# ---------- end round_angle ----------
radians = Radians(Degrees=round_angle.angle)
rotate_axis = RotateAxis(Geometry=adjust_plane, Angle=radians, Axis=rot_axis)  # -> Geometry, Transform

panel_10 = Panel(round_angle.angle)

# ----
# move plane downward
d_from_top = Data(thermo_thickness)
unit_z = UnitZ(Factor=expr("-x", d_from_top))
move_7 = Move(Geometry=rotate_axis.Geometry, Motion=unit_z)  # -> Geometry, Transform

# ----
# project a rectangular
# footprint on plane
project_along = ProjectAlong(Geometry=cull_pattern, Plane=move_7.Geometry, Direction=Vector(0, 0, -1))  # -> Geometry, Transform

explode_2 = Explode(Curve=project_along.Geometry, Recursive=True)  # -> Segments, Vertices
list_item_11 = ListItem(List=explode_2.Segments, Index=panel_3, Wrap=True)
top_edge = ListItem(List=list_item_11, Index=-1, Wrap=True)  # -> flatten(Item)
base_edge = ListItem(List=list_item_11, Index=0, Wrap=True)

# ----
# heater_base
explode_3 = Explode(Curve=cull_pattern, Recursive=True)  # -> Segments, Vertices
panel_11 = Panel("""0
2""")
list_item_12 = ListItem(List=explode_3.Segments, Index=panel_11, Wrap=True)
top_edge_2 = ListItem(List=list_item_12, Index=-1, Wrap=True)  # -> flatten(Item)
base_edge_2 = ListItem(List=list_item_12, Index=0, Wrap=True)  # -> flatten(Item)

curve_middle_3 = CurveMiddle(Curve=flatten(top_edge_2))
curve_middle_4 = CurveMiddle(Curve=flatten(top_edge))

curve_middle_5 = CurveMiddle(Curve=flatten(base_edge_2))
curve_middle_6 = CurveMiddle(Curve=flatten(base_edge))

# ----
# calculate the length
# between bottom to top
line_2 = Line(StartPoint=curve_middle_4, EndPoint=curve_middle_3)
line_3 = Line(StartPoint=curve_middle_6, EndPoint=curve_middle_5)
length_2 = Length(Curve=line_2)
length_3 = Length(Curve=line_3)

unit_y_4 = UnitY(Factor=2)
extrude = Extrude(Base=base_edge_2, Direction=unit_y_4)

unit_y_5 = UnitY(Factor=-2)
extrude_2 = Extrude(Base=top_edge_2, Direction=unit_y_5)

# ----
# mid_beam_ reference_crv
curve_middle_7 = CurveMiddle(Curve=top_edge_2)
curve_middle_8 = CurveMiddle(Curve=base_edge_2)
line_4 = Line(StartPoint=curve_middle_7, EndPoint=curve_middle_8)
offset_curve_2 = OffsetCurve(Curve=line_4, Plane=PlaneXY(0, 0, 0), Distance=1, BothSides=True, Kinks=0, CapType=1)

c_script = CSharpScript(lenA=length_2, lenB=length_3)  # -> out, shortestLength, indexLong, longestLength; inputs lenA: list of Double, lenB: list of Double
# ---------- c_script: C# ----------
    List < double > shortest = new List<double>();
    List<int> longerSideIndex = new List<int>(); // 0 is (A longer), 1 is (B longer)
    List < double > longest = new List<double>();

    for(int i = 0; i < lenA.Count;i++)
    {
      if(lenA[i] < lenB[i]){
        shortest.Add(lenA[i]);
        longest.Add(lenB[i]);
        longerSideIndex.Add(1); // B is longer
        
      }
      else{
        shortest.Add(lenB[i]);
        longest.Add(lenA[i]);

        longerSideIndex.Add(0); // A is longer
      }
    }

    longestLength = longest;
    indexLong = longerSideIndex;
    shortestLength = shortest;
# ---------- end c_script ----------
base_b = Data(graft(extrude))
base_a = Data(graft(extrude_2))
height_zshort = Data(c_script.shortestLength)

# ----
# heater_divider_wall
curve_middle_9 = CurveMiddle(Curve=line_4)
xy_plane_2 = XYPlane(Origin=curve_middle_9)
rotate = Rotate(Geometry=line_4, Angle=1.570796327, Plane=xy_plane_2)  # -> Geometry, Transform
scale = Scale(Geometry=rotate.Geometry, Center=curve_middle_9, Factor=1.1)  # -> Geometry, Transform
offset_curve_3 = OffsetCurve(Curve=scale.Geometry, Plane=PlaneXY(0, 0, 0), Distance=0.4, BothSides=True, Kinks=0, CapType=1)
unit_z_2 = UnitZ(Factor=expr("x-2", height_zshort))
extrude_3 = Extrude(Base=flatten(offset_curve_3), Direction=unit_z_2)

height_zlong = Data(c_script.longestLength)

# ----
# 3D boundary for BooleanDifference
offset_curve_4 = OffsetCurve(Curve=cull_pattern, Distance=number_slider_3, Corners=1)
unit_z_3 = UnitZ(Factor=expr("x*2", height_zlong))
extrude_4 = Extrude(Base=flatten(offset_curve_4), Direction=unit_z_3)
cap_holes_2 = CapHoles(Brep=extrude_4)

solid_difference = SolidDifference(BrepsA=cap_holes, BrepsB=cap_holes_2)
refplane_top = Plane(move_7.Geometry)

unit_z_4 = UnitZ(Factor=height_zshort)
# heater_base_model
extrude_5 = Extrude(Base=extrude_2, Direction=unit_z_4)

unit_z_5 = UnitZ(Factor=height_zshort)
extrude_6 = Extrude(Base=flatten(extrude), Direction=unit_z_5)

# ----
# middle beam base geometry
project_along_2 = ProjectAlong(Geometry=flatten(offset_curve_2), Plane=refplane_top, Direction=Vector(0, 0, -1))  # -> Geometry, Transform
unit_z_6 = UnitZ(Factor=expr("-x", Slider(2, range=0..10)))
extrude_7 = Extrude(Base=project_along_2.Geometry, Direction=unit_z_6)
cap_holes_3 = CapHoles(Brep=extrude_7)

offset_curve_5 = OffsetCurve(Curve=project_along.Geometry, Distance=number_slider_3, Corners=1)
unit_z_7 = UnitZ(Factor=10)
extrude_8 = Extrude(Base=flatten(offset_curve_5), Direction=unit_z_7)
cap_holes_4 = CapHoles(Brep=extrude_8)

custom_preview = CustomPreview(Geometry=solid_difference, Material=colour_swatch)
heater_type = Data(round_angle.type)

# ----
# thermochromic layer
solid_intersection = SolidIntersection(BrepsA=cap_holes_4, BrepsB=cap_holes)

bake_object = BakeObject(ObjectAttributes=createattributes, Bake=value_listener_11.Values, AllObjects_Object=data_4)
data_4 = Data(solid_intersection)

cap_holes_5 = CapHoles(Brep=extrude_3)
custom_preview_2 = CustomPreview(Geometry=cap_holes_5, Material=ColourSwatch(SwatchColor=RGBA(93, 0, 255, 63)))
custom_preview_3 = CustomPreview(Geometry=solid_intersection, Material=ColourSwatch(SwatchColor=RGB(255, 0, 161)))

bake_object_2 = BakeObject(ObjectAttributes=createattributes_2, Bake=value_listener_11.Values, AllObjects_Object=data_6)

bake_object_3 = BakeObject(ObjectAttributes=createattributes_3, Bake=value_listener_11.Values, AllObjects_Object=data_5)

# ----
# generate pcb
bounding_box_2 = BoundingBox(Content=first_heater, Plane=PlaneXY(0, 0, 0), UnionBox=True)  # -> Box, Box_2
area_4 = Area(Geometry=bounding_box_2.Box, UseTasks=False)  # -> Area, Centroid
move_to_point = MoveToPoint(Geometry=pcb, PointA=area_4.Centroid, PointB=data_3)  # -> Moved, Vector, Transform
bounding_box_3 = BoundingBox(Content=move_to_point.Moved, Plane=PlaneXY(0, 0, 0), UnionBox=True)  # -> Box, Box_2
custom_preview_4 = CustomPreview(Geometry=move_to_point.Moved, Material=ColourSwatch(SwatchColor=RGB(255, 255, 255)))
deconstruct_brep_3 = DeconstructBrep(Brep=bounding_box_3.Box)  # -> Faces, Edges, Vertices
area_5 = Area(Geometry=deconstruct_brep_3.Faces)  # -> flatten(Area), Centroid
sort_list_2 = SortList(Keys=area_5.Area, ValuesValuesA=deconstruct_brep_3.Faces)  # -> Keys, ValuesValuesA
number_slider_5 = Slider(2, range=0..10)
unit_z_8 = UnitZ(Factor=expr("-(x+0.2)", pcb_thickness))

# ----
# region of pcb
list_item_13 = ListItem(List=sort_list_2.ValuesValuesA, Index=-1, Wrap=True)

offset_curve_6 = OffsetCurve(Curve=list_item_13, Distance=0.2, Corners=1)
extrude_9 = Extrude(Base=offset_curve_6, Direction=unit_z_8)
cap_holes_6 = CapHoles(Brep=extrude_9)

solid_difference_2 = SolidDifference(BrepsA=solid_difference, BrepsB=simplify(cap_holes_6))
solid_union = SolidUnion(Breps=flatten([solid_difference_2, cap_holes_5]))

data_5 = Data(flatten(solid_union))

custom_preview_5 = CustomPreview(Geometry=solid_difference_2, Material=colour_swatch)
custom_preview_6 = CustomPreview(Geometry=cap_holes_6, Material=ColourSwatch(SwatchColor=RGB(49, 227, 25)))

# ----
# angle_column_mid
merge = Merge(Data1=base_a, Data2=base_b)  # -> simplify(Result)
unit_z_9 = UnitZ(Factor=height_zshort)

# ----
# heater_base
# footage(longer side)
list_item_14 = ListItem(List=merge, Index=graft(c_script.indexLong), Wrap=True)  # -> flatten(Item)

area_6 = Area(Geometry=list_item_14)  # -> Area, Centroid
rectangle_2 = Rectangle(Plane=area_6.Centroid, XSize="-1 to 1", YSize="-1 to 1", Radius=0)  # -> flatten(Rectangle), Length
move_8 = Move(Geometry=rectangle_2.Rectangle, Motion=unit_z_9)  # -> Geometry, Transform

# ----
# to generate a straight beam
# structure for steep angled
# heater, we set the top crv
# and the bottom crv reference
number_slider_6 = Slider(4, range=0..10)
addition_2 = Addition(A=height_zshort, B=number_slider_6)
project_along_3 = ProjectAlong(Geometry=list_item_14, Plane=refplane_top, Direction=Vector(0, 0, -1))  # -> Geometry, Transform
unit_z_10 = UnitZ(Factor=addition_2)
move_9 = Move(Geometry=list_item_14, Motion=unit_z_10)  # -> Geometry, Transform
offset_curve_7 = OffsetCurve(Curve=move_9.Geometry, Distance=0, Corners=1)  # -> flatten(Curve)
offset_curve_8 = OffsetCurve(Curve=project_along_3.Geometry, Distance=0, Corners=1)  # -> flatten(Curve)

# ----
# project the footprint of the column_mid
# to the top srf -> later we will
# loft these two curves
project_along_4 = ProjectAlong(Geometry=move_8.Geometry, Plane=refplane_top, Direction=Vector(0, 0, -1))  # -> Geometry, Transform

generateheater = CSharpScript(
    heaterType=heater_type,
    baseCrvColumn=move_8.Geometry,
    topCrvColumn=project_along_4.Geometry,
    baseHeaterGeometry=cap_holes_3,
    baseCrvBeam=offset_curve_7,
    topCrvBeam=offset_curve_8)  # -> out, A; inputs heaterType: list of Int32, baseCrvColumn: list of Curve, topCrvColumn: list of Curve, baseHeaterGeometry: list of Brep, baseCrvBeam: list of Curve, topCrvBeam: list of Curve
# ---------- generateheater: C# ----------
    List<Brep> heaterGeometry = new List<Brep>();
    for(int i = 0 ; i < heaterType.Count;i++)
    {
      var crvs = new List<Curve>();
      if(heaterType[i] < 2)heaterGeometry.Add(baseHeaterGeometry[i]); // if not steep angled, then just add the base geometry

      if(heaterType[i] == 1)
      {
        crvs.Add(baseCrvColumn[i]);
        crvs.Add(topCrvColumn[i]);

        var loftedSrf = Brep.CreateFromLoft(crvs, Point3d.Unset, Point3d.Unset, LoftType.Normal, false);
        for(int j = 0 ; j < loftedSrf.Length;j++)
        {
          heaterGeometry.Add(loftedSrf[j]);
        }
      }
      else if(heaterType[i] == 2) // steep angled
      {
        // move column and angled beam
        Transform moveHeaterBeam = Transform.Translation(2.0, 0.0, 0.0);
        Transform moveHeaterColumn = Transform.Translation(-2.0, 0.0, 0.0);

        baseHeaterGeometry[i].Transform(moveHeaterBeam);
        baseCrvColumn[i].Transform(moveHeaterColumn);
        topCrvColumn[i].Transform(moveHeaterColumn);

        // loft column
        crvs.Add(baseCrvColumn[i]);
        crvs.Add(topCrvColumn[i]);
        var loftedSrfColumn = Brep.CreateFromLoft(crvs, Point3d.Unset, Point3d.Unset, LoftType.Normal, false);
        for(int j = 0 ; j < loftedSrfColumn.Length;j++)
        {
          heaterGeometry.Add(loftedSrfColumn[j]);
        }
        heaterGeometry.Add(baseHeaterGeometry[i]);


        // loft straight beam
        crvs.Clear();
        crvs.Add(baseCrvBeam[i]);
        crvs.Add(topCrvBeam[i]);
        var loftedSrfBeam = Brep.CreateFromLoft(crvs, Point3d.Unset, Point3d.Unset, LoftType.Normal, false);
        for(int j = 0 ; j < loftedSrfBeam.Length;j++)
        {
          heaterGeometry.Add(loftedSrfBeam[j]);
        }
//        Print("bb");

      }





    }

    A = heaterGeometry;
# ---------- end generateheater ----------
cap_holes_7 = CapHoles(Brep=generateheater.A)
merge_2 = Merge(Data1=cap_holes_7, Data2=extrude_5, Data3=extrude_6)
solid_union_2 = SolidUnion(Breps=merge_2)

data_6 = Data(solid_union_2)

custom_preview_7 = CustomPreview(Geometry=solid_union_2, Material=ColourSwatch(SwatchColor=RGB(128, 128, 128)))

# ==== cluster Cluster
content = ClusterInput()
bounding_box = BoundingBox(Content=content, Plane=PlaneXY(0, 0, 0))  # -> Box, Box_2
deconstruct_box = DeconstructBox(Box=bounding_box.Box_2)  # -> Plane, X, Y, Z
deconstruct_domain = DeconstructDomain(Domain=deconstruct_box.Z)  # -> Start, End
distance_from_base = ClusterInput()
subtraction = Subtraction(A=deconstruct_domain.Start, DistanceFromBase=distance_from_base)
construct_point = ConstructPoint(XCoordinate=0, YCoordinate=0, ZCoordinate=subtraction)
xy_plane = XYPlane(Origin=construct_point)
plane = ClusterOutput(xy_plane)
